# Dynamo graph Lession 1.dyn (Dynamo 2.19.3.6394)

code_block = CodeBlock { [1,2,3,4,5,6,7,8,9,10,11,12]; }
code_block_2 = CodeBlock { 4; }
byCoordinates = Point.ByCoordinates(x=code_block, z=code_block_2)
count = List.Count(list=byCoordinates)
code_block_3 = CodeBlock(len=count) { [0..len-1..2]; }
getItemAtIndex = List.GetItemAtIndex(list=byCoordinates, index=code_block_3)
code_block_4 = CodeBlock { 2; }
byCoordinates_2 = Point.ByCoordinates(x=code_block, y=code_block_4, z=code_block_2)
count_2 = List.Count(list=byCoordinates_2)
code_block_5 = CodeBlock(len=count_2) { [1..len-1..2]; }
getItemAtIndex_2 = List.GetItemAtIndex(list=byCoordinates_2, index=code_block_5)
byStartPointEndPoint = Line.ByStartPointEndPoint(startPoint=getItemAtIndex, endPoint=getItemAtIndex_2)
code_block_6 = CodeBlock(a=getItemAtIndex) { a[0]; }
code_block_7 = CodeBlock { 1; }
dropItems = List.DropItems(list=code_block_6, amount=code_block_7)
code_block_8 = CodeBlock(a=getItemAtIndex_2) { a[0]; }
byStartPointEndPoint_2 = Line.ByStartPointEndPoint(startPoint=dropItems, endPoint=code_block_8)
byCoordinates_3 = Point.ByCoordinates(x=code_block, z=code_block_2)
count_3 = List.Count(list=byCoordinates_3)
code_block_9 = CodeBlock(len=count_3) { [1..len-1..2]; }
getItemAtIndex_3 = List.GetItemAtIndex(list=byCoordinates_3, index=code_block_9)
code_block_10 = CodeBlock { 2; }
byCoordinates_4 = Point.ByCoordinates(x=code_block, y=code_block_10, z=code_block_2)
count_4 = List.Count(list=byCoordinates_4)
code_block_11 = CodeBlock(len=count_4) { [0..len-1..2]; }
getItemAtIndex_4 = List.GetItemAtIndex(list=byCoordinates_4, index=code_block_11)
byStartPointEndPoint_3 = Line.ByStartPointEndPoint(startPoint=getItemAtIndex_3, endPoint=getItemAtIndex_4)
code_block_12 = CodeBlock(a=getItemAtIndex_3) { a[0]; }
code_block_13 = CodeBlock(a=getItemAtIndex_4) { a[0]; }
code_block_14 = CodeBlock { 1; }
dropItems_2 = List.DropItems(list=code_block_13, amount=code_block_14)
byStartPointEndPoint_4 = Line.ByStartPointEndPoint(startPoint=code_block_12, endPoint=dropItems_2)
code_block_15 = CodeBlock { 2; }
byCoordinates_5 = Point.ByCoordinates(x=code_block, y=code_block_15, z=code_block_2)
count_5 = List.Count(list=byCoordinates_5)
code_block_16 = CodeBlock(len=count_5) { [0..len-1..2]; }
getItemAtIndex_5 = List.GetItemAtIndex(list=byCoordinates_5, index=code_block_16)
code_block_17 = CodeBlock { 4; }
byCoordinates_6 = Point.ByCoordinates(x=code_block, y=code_block_17, z=code_block_2)
count_6 = List.Count(list=byCoordinates_6)
code_block_18 = CodeBlock(len=count_6) { [1..len-1..2]; }
getItemAtIndex_6 = List.GetItemAtIndex(list=byCoordinates_6, index=code_block_18)
byStartPointEndPoint_5 = Line.ByStartPointEndPoint(startPoint=getItemAtIndex_5, endPoint=getItemAtIndex_6)
code_block_19 = CodeBlock(a=getItemAtIndex_5) { a[0]; }
code_block_20 = CodeBlock { 1; }
dropItems_3 = List.DropItems(list=code_block_19, amount=code_block_20)
code_block_21 = CodeBlock(a=getItemAtIndex_6) { a[0]; }
byStartPointEndPoint_6 = Line.ByStartPointEndPoint(startPoint=dropItems_3, endPoint=code_block_21)
code_block_22 = CodeBlock { 2; }
byCoordinates_7 = Point.ByCoordinates(x=code_block, y=code_block_22, z=code_block_2)
count_7 = List.Count(list=byCoordinates_7)
code_block_23 = CodeBlock(len=count_7) { [1..len-1..2]; }
getItemAtIndex_7 = List.GetItemAtIndex(list=byCoordinates_7, index=code_block_23)
code_block_24 = CodeBlock { 4; }
byCoordinates_8 = Point.ByCoordinates(x=code_block, y=code_block_24, z=code_block_2)
count_8 = List.Count(list=byCoordinates_8)
code_block_25 = CodeBlock(len=count_8) { [0..len-1..2]; }
getItemAtIndex_8 = List.GetItemAtIndex(list=byCoordinates_8, index=code_block_25)
byStartPointEndPoint_7 = Line.ByStartPointEndPoint(startPoint=getItemAtIndex_7, endPoint=getItemAtIndex_8)
code_block_26 = CodeBlock(a=getItemAtIndex_7) { a[0]; }
code_block_27 = CodeBlock(a=getItemAtIndex_8) { a[0]; }
code_block_28 = CodeBlock { 1; }
dropItems_4 = List.DropItems(list=code_block_27, amount=code_block_28)
byStartPointEndPoint_8 = Line.ByStartPointEndPoint(startPoint=code_block_26, endPoint=dropItems_4)
code_block_29 = CodeBlock { 4; }
byCoordinates_9 = Point.ByCoordinates(x=code_block, y=code_block_29)
firstItem = List.FirstItem(list=byCoordinates_9)
firstItem_2 = List.FirstItem(list=byCoordinates_6)
byStartPointEndPoint_9 = Line.ByStartPointEndPoint(startPoint=firstItem, endPoint=firstItem_2)
byCoordinates_10 = Point.ByCoordinates(x=code_block)
firstItem_3 = List.FirstItem(list=byCoordinates_10)
firstItem_4 = List.FirstItem(list=byCoordinates)
byStartPointEndPoint_10 = Line.ByStartPointEndPoint(startPoint=firstItem_3, endPoint=firstItem_4)
lastItem = List.LastItem(list=byCoordinates_9)
lastItem_2 = List.LastItem(list=byCoordinates_6)
byStartPointEndPoint_11 = Line.ByStartPointEndPoint(startPoint=lastItem, endPoint=lastItem_2)
lastItem_3 = List.LastItem(list=byCoordinates_10)
lastItem_4 = List.LastItem(list=byCoordinates)
byStartPointEndPoint_12 = Line.ByStartPointEndPoint(startPoint=lastItem_3, endPoint=lastItem_4)
